# Grasshopper definition display.gh (Grasshopper 1.0.7)
# plug-ins: blackCokatoo, Tarsier

panel = Panel("0.05")
int = Integer("10")
panel_2 = Panel("10")
gradient_flat_catogiries = Slider(2, range=0..2)

isculled = BooleanToggle(False)
cut_off = Slider(0.001, range=0..1)

blackcokatoo = BlackCokatoo()  # -> Output, BranchID, BranchOrder, SegmentID, Lengthtoleave, LeafCount, Canopy, Canopy_2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
values = Data(blackcokatoo.Lengthtoleave)

gradient = Gradient(LowerLimit=0, UpperLimit=1, stops=[0.15: RGB(255, 130, 160), 0.85: RGB(220, 0, 40)])
bnd = Bounds(Numbers=blackcokatoo.Gradient)
angle = Number(blackcokatoo.Gradient)
expression = Expression(x=angle, Expression="x-1")
mesh = Mesh(blackcokatoo.Pipe)
lng = ListLength(List=angle)
larger = LargerThan(FirstNumber=blackcokatoo.LeafCount, SecondNumber="0")  # -> LargerThan, OrEqualTo
crv = Curve(blackcokatoo.Canopy)
gradient_2 = Gradient(LowerLimit=0, UpperLimit=1, Parameter=angle, stops=[0: RGB(0, 42, 255), 1: RGB(255, 0, 81)])
series = Series(Start=0, Step=1, Count=lng)  # disabled
leaf_count = Integer(blackcokatoo.LeafCount)
crv_2 = Curve(blackcokatoo.Output)
pattern = Boolean(larger.OrEqualTo)
end = EndPoints(Curve=crv)  # -> Start, End
bnd_2 = Bounds(Numbers=series)  # disabled
remap = RemapNumbers(Value=series, Source=bnd_2, Target=Domain(0, 1))  # -> Mapped, Clipped; disabled
pt = Point(end.End)
number_slider = Slider(0.1, range=0..0.1)
cull = CullPattern(List=crv_2, CullPattern=pattern)
pt_2 = ConstructPoint(XCoordinate=remap.Mapped, YCoordinate=angle, ZCoordinate=0)  # disabled
cull_2 = CullPattern(List=leaf_count, CullPattern=pattern)
preview = PreviewPointCloud(PointCloud=blackcokatoo.Canopy_2, Weight="5")
mcol = MeshColours(Mesh=simplify(graft(mesh)), Colours=simplify(graft(gradient_2)))
dots = DotDisplay(Point=end.Start, Colour=RGB(0, 0, 0), Size=Slider(0.1, range=0..1))
crv_3 = Curve(cull)
values_2 = Data(cull_2)
end_2 = EndPoints(Curve=crv_3)  # -> Start, End
deconstruct = DeconstructPointCloud(PointCloud=blackcokatoo.Canopy_2)  # -> Points, Colours, Normals
pt_3 = Point(end_2.End)
smaller = SmallerThan(FirstNumber=values_2, SecondNumber="300")  # -> SmallerThan, OrEqualTo
preview_2 = CustomPreview(Geometry=mesh, Material=ColourSwatch(SwatchColor=RGB(46, 46, 46)))
lng_2 = ListLength(List=deconstruct.Points)
pattern_2 = Boolean(smaller.SmallerThan)
data = Data(blackcokatoo.Pipe)
pattern_3 = Boolean(larger.OrEqualTo)
cull_3 = CullPattern(List=crv_3, CullPattern=pattern_2)
cull_4 = CullPattern(List=values_2, CullPattern=pattern_2)
repeat = RepeatData(Data=ColourSwatch(SwatchColor=RGBA(47, 255, 0, 147)), Length=lng_2)
construct = ConstructPointCloud(Points=deconstruct.Points, Colours=repeat)
values_3 = Data(cull_4)
sort = SortList(Keys=values_3)  # -> Keys, ValuesA
crv_4 = Curve(cull_3)
lng_3 = ListLength(List=sort.Keys)
preview_3 = PreviewPointCloud(PointCloud=construct, Weight="5")
cull_5 = CullPattern(List=data, CullPattern=pattern_3)
series_2 = Series(Start=0, Step=1, Count=lng_3)
bnd_3 = Bounds(Numbers=sort.Keys)
bnd_4 = Bounds(Numbers=series_2)
remap_2 = RemapNumbers(Value=sort.Keys, Source=bnd_3, Target=Domain(0, 1))  # -> Mapped, Clipped
mesh_2 = Mesh(blackcokatoo.HorizontalPipes)
remap_3 = RemapNumbers(Value=series_2, Source=bnd_4, Target=Domain(0, 1))  # -> Mapped, Clipped
data_2 = Data(mesh_2)
pattern_4 = Boolean(smaller.SmallerThan)
pt_4 = ConstructPoint(XCoordinate=remap_2.Mapped, YCoordinate=remap_3.Mapped, ZCoordinate=0)
bnd_5 = Bounds(Numbers=values_3)
cull_6 = CullPattern(List=data_2, CullPattern=pattern_4)
end_3 = EndPoints(Curve=crv_4)  # -> Start, End
remap_4 = RemapNumbers(Value=values_3, Source=bnd_5, Target=Domain(0, 1))  # -> Mapped, Clipped
gradient_3 = Gradient(LowerLimit=0, UpperLimit=1, Parameter=remap_4.Mapped, stops=[0: RGB(255, 0, 0), 1: RGB(0, 255, 0)])
data_3 = Data(cull_6)
branch_tips = Point(end_3.End)
number_slider_2 = Slider(0.1, range=0..0.1)
mcol_2 = MeshColours(Mesh=graft(data_3), Colours=graft(gradient_3))
exposed_branch_segments = Mesh(flatten(mcol_2))
number_slider_3 = Slider(0.1, range=0..0.1)
cset = CreateSet(List=values)  # -> flatten(Set), Map
lng_4 = ListLength(List=cset.Set)
number_of_catagories = Panel(lng_4)
bnd_6 = Bounds(Numbers=values)
dots_2 = DotDisplay(Point=branch_tips, Colour=gradient_3, Size=".05")
remap_5 = RemapNumbers(Value=values, Source=bnd_6, Target=Domain(0, 1))  # -> Mapped, Clipped
wheel = ColourWheel(
    flatten(lng_4),
    ColourGrips_Style=31,
    ColourGrips_Grip=[0.9110725852, 3.005467688, 5.09986279, 4.052665239],
    ColourGrips_Lum=[0.4122612, 0.5132723965],
    ColourGrips_Range=[0.2617993878, 0.2617993878, 0.2617993878, 0.2617993878],
    ColourGrips_Sat=[0.8988689905, 0.9907705853])
msphere = MeshSphere(Base=branch_tips, Radius=Slider(0.4, range=0..1), UCount=10, VCount=20)
gradient_4 = Gradient(
    LowerLimit=0,
    UpperLimit=1,
    Parameter=remap_5.Mapped,
    stops=[0: RGB(120, 184, 38), 0: RGB(127, 222, 249), 0: RGB(205, 139, 90), 0: RGB(95, 242, 7), 1: RGB(220, 0, 40)])
crv_5 = Curve(blackcokatoo.Output)
mcol_3 = MeshColours(Mesh=graft(msphere), Colours=graft(gradient_3))
original_unqiue_data = Data(cset.Set)
data_4 = Data(values)
colours = Data(wheel)
flatten = FlattenTree(Tree=mcol_3, Path="{0}")
mjoin = MeshJoin(Meshes=flatten)
index = Number(cut_off)
bnd_7 = Bounds(Numbers=data_4)
replace = ReplaceMembers(Set=data_4, Find=original_unqiue_data, Replace=colours)
remap_6 = RemapNumbers(Value=index, Source=Domain(0, 1), Target=bnd_7)  # -> Mapped, Clipped
catagory = Colour(replace)
gradient_5 = Colour(gradient_4)
int_2 = Integer(gradient_flat_catogiries)
entwine = Entwine(Branch00=catagory, Branch01=gradient_5, Branch02=ColourSwatch(SwatchColor=RGB(255, 0, 0)), FlattenInputs=True)  # -> simplify(Result)
round = Round(Number=remap_6.Mapped)  # -> Nearest, Floor, Ceiling
num = Number(remap_6.Mapped)
path = ConstructPath(Indices=int_2)
branch = TreeBranch(Tree=entwine, Path=path, MaintainPaths=True)
smaller_2 = SmallerThan(FirstNumber=data_4, SecondNumber=num)  # -> SmallerThan, OrEqualTo
length_to_leave = Data(blackcokatoo.Lengthtoleave)
bool = Boolean(smaller_2.OrEqualTo)
crv_6 = Curve(crv_5)
smaller_3 = SmallerThan(FirstNumber=length_to_leave, SecondNumber="0.05")  # -> SmallerThan, OrEqualTo
entwine_2 = Entwine(Branch00=crv_5, Branch01=branch, FlattenInputs=True)  # -> simplify(Result)
bool_2 = Boolean(smaller_3.OrEqualTo)
cull_7 = CullPattern(List=entwine_2, CullPattern=bool)
cull_8 = CullPattern(List=crv_6, CullPattern=bool_2)
complete = Data(entwine_2)
culled = Data(cull_7)
bang = ExplodeTree(Data=cull_7)  # -> Branch0, Branch1
end_4 = EndPoints(Curve=cull_8)  # -> Start, End
entwine_3 = Entwine(Branch0X=complete, Branch1X=culled, FlattenInputs=False)  # -> simplify(Result)
number_slider_4 = Slider(1, range=0..1)
end_pts = Point(end_4.Start)

# ---- group: Endbranch tips
dots_3 = DotDisplay(Point=end_pts, Colour=ColourSwatch(SwatchColor=RGB(0, 255, 255)), Size=Slider(0.1, range=0..0.1))

# ----
isculled_2 = Boolean(isculled)
int_3 = Integer(isculled_2)
concat = Concatenate(FragmentA="{", FragmentB=int_3, FragmentC=";?}")
split = SplitTree(Data=entwine_3, Masks=flatten(concat))  # -> Positive, Negative
msphere_2 = MeshSphere(Base=end_pts, Radius=Slider(1, range=0..1), UCount=10, VCount=20)  # disabled
bang_2 = ExplodeTree(Data=split.Positive)  # -> Branch0, Branch1
preview_4 = CustomPreview(Geometry=bang_2.Branch0, Material=bang_2.Branch1)
