# Grasshopper definition quick display.gh (Grasshopper 1.0.7)
# plug-ins: blackCokatoo, Tarsier

blackcokatoo = BlackCokatoo()  # -> Output, BranchID, BranchOrder, SegmentID, Lengthtoleave, LeafCount, ExposedBranches, Canopy
number_slider = Slider(0.1, range=0..0.1)
crv = Curve(blackcokatoo.ExposedBranches)
crv_2 = Curve(blackcokatoo.Output)
end = EndPoints(Curve=crv)  # -> Start, End
number_slider_2 = Slider(0.1, range=0..0.1)
preview = PreviewPointCloud(PointCloud=blackcokatoo.Canopy, Weight=Slider(3, range=0..10))
dots = DotDisplay(Point=end.Start, Colour=RGB(0, 0, 0), Size=Slider(0.5, range=0..1))
